# Grasshopper definition 03.0.cullPattern.gh (Grasshopper 1.0.7)
# plug-ins: Bifocals

cir = Circle(Plane=PlaneXY(0, 0, 0), Radius="500")
boundary = BoundarySurfaces(Edges=cir)
number_slider = Slider(5, range=0..10)
number_slider_2 = Slider(100, range=0..100)
number_slider_3 = Slider(100, range=0..100)
series = Series(Start=0, Step=Slider(9, range=0..10), Count=10)
panel = Panel(series)
popgeo = PopulateGeometry(Geometry=boundary, Count=Slider(59, range=0..100), Seed=1)
sqgrid = Square(Plane=PlaneXY(0, 0, 0), Size=number_slider_2, ExtentX=number_slider, ExtentY=number_slider)  # -> Cells, Points
hexgrid = Hexagonal(Plane=PlaneXY(0, 0, 0), Size=number_slider_2, ExtentX=number_slider, ExtentY=number_slider)  # -> Cells, Points
voronoi = Voronoi(Points=popgeo, Radius=Slider(150, range=50..150), BruteForceOverride=False)
rectangle = Rectangle(Plane=PlaneXY(0, 0, 0), XSize=number_slider_3, YSize=number_slider_3, Radius=0)  # -> Rectangle, Length

bnd = Bounds(Numbers=series)
dom = ConstructDomain(DomainStart="50", DomainEnd="100")
remap = RemapNumbers(Value=series, Source=bnd, Target=dom)  # -> Mapped, Clipped

explode = Explode(Curve=sqgrid.Cells, Recursive=True)  # -> Segments, Vertices
panel_2 = Panel(remap.Mapped)
number_slider_4 = Slider(7, range=1..20)
shift = ShiftList(List=explode.Segments, Shift=Slider(1, range=1..5), Wrap=True)
number_slider_5 = Slider(194, range=0..200)
pt = Point(Point(164.8477981, 157.3584023, 0))
divide = DivideCurve(Curve=explode.Segments, Count=number_slider_4, Kinks=False)  # -> Points, Tangents, Parameters
divide_2 = DivideCurve(Curve=shift, Count=number_slider_4, Kinks=False)  # -> Points, Tangents, Parameters
dist = Distance(PointA=pt)
shift_2 = ShiftList(List=divide_2.Points, Shift=Slider(0, range=0..20), Wrap=True)
number_slider_6 = Slider(5, range=0..10)
larger = LargerThan(FirstNumber=dist, SecondNumber=number_slider_5)  # -> LargerThan, OrEqualTo
cir_2 = Circle(Plane=pt, Radius=number_slider_5)
ln = Line(StartPoint=divide.Points, EndPoint=shift_2)
pt_2 = Point(Point(106.2328728, 113.9750748, 0))
sqgrid_2 = Square(Plane=PlaneXY(0, 0, 0), Size=Slider(50, range=0..100), ExtentX=number_slider_6, ExtentY=number_slider_6)  # -> Cells, Points
lng = ListLength(List=ln)
number_slider_7 = Slider(96, range=0..200)
bnd_2 = Bounds(Numbers=flatten(dist))
dom_2 = ConstructDomain(DomainStart=Slider(0, range=0..10), DomainEnd=Slider(10, range=0..10))
series_2 = Series(Start=0, Step=1, Count=lng)
dist_2 = Distance(PointA=pt_2, PointB=sqgrid_2.Points)
remap_2 = RemapNumbers(Value=dist, Source=bnd_2, Target=dom_2)  # -> Mapped, Clipped
gradient = Gradient(
    LowerLimit=0,
    UpperLimit=lng,
    Parameter=series_2,
    stops=[0: RGB(243, 57, 0), 0.1: RGB(236, 27, 60), 0.2: RGB(210, 0, 118), 0.3: RGB(103, 0, 120), 0.4: RGB(39, 72, 161), 0.5: RGB(1, 192, 229), 0.6: RGB(18, 178, 90), 0.7: RGB(79, 186, 8), 0.8: RGB(220, 237, 32), 0.9: RGB(247, 159, 20), 1: RGB(243, 57, 0)])
round = Round(Number=remap_2.Mapped)  # -> Nearest, Floor, Ceiling
larger_2 = LargerThan(FirstNumber=dist_2, SecondNumber=number_slider_7)  # -> LargerThan, OrEqualTo
cir_3 = Circle(Plane=pt_2, Radius=number_slider_7)
dispatch = Dispatch(List=round.Nearest, DispatchPattern=larger.LargerThan)  # -> ListA, ListB
preview = CustomPreview(Geometry=ln, Material=gradient)
bnd_3 = Bounds(Numbers=flatten(dist_2))
dom_3 = ConstructDomain(DomainStart=Slider(28, range=15..40), DomainEnd=Slider(5, range=5..40))
dom_4 = ConstructDomain(DomainStart=Slider(5, range=5..40), DomainEnd=Slider(40, range=15..40))
remap_3 = RemapNumbers(Value=dist_2, Source=bnd_3, Target=dom_3)  # -> Mapped, Clipped
remap_4 = RemapNumbers(Value=dist_2, Source=bnd_3, Target=dom_4)  # -> Mapped, Clipped
dispatch_2 = Dispatch(List=remap_4.Mapped, DispatchPattern=larger_2.LargerThan)  # -> ListA, ListB
dispatch_3 = Dispatch(List=sqgrid_2.Points, DispatchPattern=larger_2.LargerThan)  # -> ListA, ListB
dispatch_4 = Dispatch(List=remap_3.Mapped, DispatchPattern=larger_2.LargerThan)  # -> ListA, ListB
polygon = Polygon(Plane=dispatch_3.ListA, Radius=dispatch_4.ListA, Segments=6, FilletRadius=0)  # -> Polygon, Length
polygon_2 = Polygon(Plane=dispatch_3.ListB, Radius=dispatch_2.ListB, Segments="4", FilletRadius=0)  # -> Polygon, Length
boundary_2 = BoundarySurfaces(Edges=polygon.Polygon)
boundary_3 = BoundarySurfaces(Edges=polygon_2.Polygon)
preview_2 = CustomPreview(Geometry=boundary_2, Material=ColourSwatch(SwatchColor=RGB(255, 0, 234)))
preview_3 = CustomPreview(Geometry=boundary_3, Material=ColourSwatch(SwatchColor=RGB(0, 187, 255)))
