# Grasshopper definition 0505_truhetBasicImg.gh (Grasshopper 1.0.7)
# plug-ins: Bifocals

sqgrid = Square(Plane=PlaneXY(0, 0, 0), Size=Slider(10, range=3..20), ExtentX=Slider(60, range=0..100), ExtentY=Slider(80, range=0..100))  # -> simplify(Cells), Points
area = Area(Geometry=sqgrid.Cells)  # -> Area, flatten(Centroid)
image = ImageSampler(area.Centroid, Filter="Value", Interpolate=True, Umax=600, Umin=0, Vmax=800, Vmin=0, Wrap=1)
bnd = Bounds(Numbers=image)
dom = ConstructDomain(DomainStart="3", DomainEnd="0")
remap = RemapNumbers(Value=image, Source=bnd, Target=dom)  # -> Mapped, Clipped
bnd_2 = Bounds(Numbers=remap.Mapped)
remap_2 = RemapNumbers(Value=remap.Mapped, Source=bnd_2, Target=Domain(0, 1))  # -> Mapped, Clipped
target = Curve(sqgrid.Cells)
unit1 = Curve([<curve referenced from the Rhino model> x4])
unit2 = Curve([<curve referenced from the Rhino model> x4])
unit3 = Curve([<curve referenced from the Rhino model> x4])
unit4 = Curve([<curve referenced from the Rhino model> x4])
graph = GraphMapper(remap_2.Mapped, x0=0, x1=1, y0=0, y1=1, container_name="Bezier", cpx=[0, 1, 0, 1], cpy=[0, 0, 1, 1])
group = Group(Objects=unit1)
group_2 = Group(Objects=unit2)
group_3 = Group(Objects=unit3)
group_4 = Group(Objects=unit4)
bbox = BoundingBox(Content=group, Plane=PlaneXY(0, 0, 0), UnionBox=False)  # -> Box, Box_2
bbox_2 = BoundingBox(Content=group_2, Plane=PlaneXY(0, 0, 0), UnionBox=False)  # -> Box, Box_2
bbox_3 = BoundingBox(Content=group_3, Plane=PlaneXY(0, 0, 0), UnionBox=False)  # -> Box, Box_2
bbox_4 = BoundingBox(Content=group_4, Plane=PlaneXY(0, 0, 0), UnionBox=False)  # -> Box, Box_2
remap_3 = RemapNumbers(Value=graph, Source=Domain(0, 1), Target=bnd_2)  # -> Mapped, Clipped
round = Round(Number=remap_3.Mapped)  # -> Nearest, Floor, Ceiling
recmap = RectangleMapping(Geometry=group, Source=bbox.Box, Target=target)  # -> Geometry, Transform
recmap_2 = RectangleMapping(Geometry=group_2, Source=bbox_2.Box, Target=target)  # -> Geometry, Transform
recmap_3 = RectangleMapping(Geometry=group_3, Source=bbox_3.Box, Target=target)  # -> Geometry, Transform
recmap_4 = RectangleMapping(Geometry=group_4, Source=bbox_4.Box, Target=target)  # -> Geometry, Transform
p_n_c = PickNChoose(
    Pattern=round.Nearest,
    Stream0=flatten(recmap.Geometry),
    Stream1=flatten(recmap_2.Geometry),
    Stream2=flatten(recmap_3.Geometry),
    Stream3=flatten(recmap_4.Geometry))
ungroup = Ungroup(Group=p_n_c)
bbox_5 = BoundingBox(Content=p_n_c, Plane=PlaneXY(0, 0, 0), UnionBox=True)  # -> Box, Box_2
curvepoint = PointOnCurve(ungroup, parameter=0.5)
debrep = DeconstructBrep(Brep=bbox_5.Box)  # -> Faces, Edges, Vertices
join = JoinCurves(Curves=debrep.Edges, Preserve=False)
image_2 = ImageSampler(curvepoint, Filter="Colour", Interpolate=True, Umax=600, Umin=0, Vmax=800, Vmin=0, Wrap=1)
panel = Panel(image_2)
preview = CustomPreview(Geometry=ungroup, Material=image_2)
